# Dynamo graph Geometry.dyn (Dynamo 2.16.0.1640)

code_block = CodeBlock { x; }  # unwired: x
code_block_2 = CodeBlock(x=code_block) { x; }
code_block_3 = CodeBlock { x; }  # unwired: x
code_block_4 = CodeBlock(x=code_block_3) { x; }
code_block_5 = CodeBlock { x; }  # unwired: x
code_block_6 = CodeBlock(x=code_block_5) { x; }
code_block_7 = CodeBlock { 0..10; 10; }
byLengths = Cuboid.ByLengths(width=code_block_7.out1, length=code_block_7.out1)
translate = Geometry.Translate(geometry=byLengths, xTranslation=code_block_7.out0, yTranslation=code_block_7.out0, zTranslation=code_block_7.out0)
