# Dynamo graph GraphNodeManagerTestGraph_NullsEmptyLists.dyn (Dynamo 2.16.0.1640)

lists = CodeBlock()
# ---------- lists.designscript (17 lines) ----------
listWithNull = [1,2,"hi",null];
listWithEmpty = [[],2,3,[],"bye"];
listWithBoth = [1,2,null,4,"five",[],null];
mestedListsWithBoth = [
	[
		null,1,2
	],
	[
		"string",2,3
	],
	[
		12,"hi","bye",
			[
				1,2,null,[]
			]
	]
];
# ----------------------------------------
list_with_nulls_and_empty_list = Watch(lists.listWithBoth)
