# Dynamo graph ZoomNodeColorStates.dyn (Dynamo 2.15.0.4881)

code_block = CodeBlock { "No Warning Bar"; }
code_block_2 = CodeBlock { Warning Bar Error Hidden; }
code_block_3 = CodeBlock { Warning Bar Error Frozen Hidden; }  # frozen
code_block_4 = CodeBlock { "Warning Bar Warning"; a = b; b = a; }
code_block_5 = CodeBlock { "No Warning Bar Hidden"; }
code_block_6 = CodeBlock { "No Warning Bar Frozen"; }  # frozen
code_block_7 = CodeBlock { "No Warning Bar Hidden Frozen"; }  # frozen
code_block_8 = CodeBlock { "Warning Bar Warning Hidden"; a = b; b = a; }
code_block_9 = CodeBlock { "Warning Bar Warning Frozen Hidden"; a = b; b = a; }  # frozen
code_block_10 = CodeBlock { Warning Bar Error; }
unresolved = TonsOfWarnings.TonsOfWarningsFunction.tonsOfWarnings()
boolean = BoolSelector(false)  # graph input
boolean_2 = BoolSelector(false)  # graph input; graph output
list_create = List.Create()  # unwired: item0
list_create_2 = List.Create(item0=list_create)
integer_slider = IntegerSlider(1, range=0..100 step 1)
